# Grasshopper definition Splatypus_Workflow.gh (Grasshopper 1.0.8)
# plug-ins: Splatypus

# ----
# TOOLS — REQUIRED
# Provide valid FFmpeg, COLMAP and Brush executable paths.
# Alternatively, click Download on Download Tools.
# Wait until Ready = True.
# Existing valid installations are reused.
# 
# On Windows, enable CUDA when using a compatible NVIDIA GPU.
# Use the CPU option for COLMAP otherwise.
# Brush requires a compatible graphics device.
toggle = BooleanToggle(True)
sp_download_tools = SPDownloadTools(COLMAPCUDA=toggle, Download=Button(), Cancel=Button(), ShowTerminal=Toggle(True))  # -> FFmpeg, COLMAP, Brush, Ready, Versions, Status, LogFile

# ---- group: Project Root
# Project Template 0.2.0
# SPLATYPUS — WORKFLOW GUIDE
# Create a project → Import media → Reconstruct with COLMAP → Prepare a dataset → Train → Preview.
# 
# REQUIRED steps produce the trained model.
# OPTIONAL steps provide checks, alignment or viewing.
# If a step is already complete, reuse its outputs.
# RERUNNING THE WORKFLOW
# After changing images or reconstruction settings,
# rerun the affected steps and regenerate downstream outputs.
# After changing alignment, write the model again,
# prepare the dataset again and retrain.
# Use a new project or training job name to keep separate results.
# 00 Path
# Splatypus 0.2.0
# 
#  Added
# 
# - Quick Align: align a reconstruction to Rhino geometry using three point pairs, with refinement, reset and alignment error feedback.
# - Video Frames and Video Playback: browse extracted frames by source video and move the Rhino camera along reconstructed tracks, with smooth playback, seeking, speed and loop controls.
# - View Capture: capture the Rhino scene from known camera frames and prepare calibrated images for Brush training without repeating camera reconstruction.
# - Auto Background: estimate a solid or gradient backdrop from splat colors, preview it in Rhino and use it for viewport capture.
# 
#  Updated
# 
# - Media Import: choose JPEG or PNG, preserve existing transparency with PNG and optionally skip near-duplicate video frames while retaining playback timing.
# - COLMAP: choose Exhaustive, Sequential, Spatial or Auto matching, and adjust feature extraction resolution and feature count.
# - Alignment: combine Quick Align with Geometry Translator fine adjustments and save the complete alignment consistently with the preview.
# - Brush Train: adjust training resolution and maximum splat count.
# - Camera Planes: output camera frames that connect directly to View Capture.
# Choose the parent folder for your project.
# Use a separate project folder for each dataset.
path = FilePath()

# ----
enter_a_project_name = Panel("")
# 01 Setup
# PROJECT — REQUIRED
# Set a Parent Folder and Project Name.
# Set Create = True to create the project folders.
# Connect the project’s Root output to downstream Root inputs.
# Use a separate project for each dataset.
sp_hello = SPHello(Message="Ready")
sp_project = SPProject(ParentFolder=path, ProjectName=enter_a_project_name, Create=Toggle(True))  # -> ProjectRoot, Images, COLMAP, Brush, Status
# COMMON OPTIONS
# 
# Replace:
# Enable only when intentionally replacing a component’s
# previous output. Leave False for a first run.
# Terminal:
# Shows live processing information.
# Viewer:
# Opens Brush’s interactive training viewer.
# Cancel:
# Stops the current operation where available.
# Completed downloads, imported images or exported
# training checkpoints may remain.
panel = Panel(sp_hello)
panel_2 = Panel(sp_project.Status)

# ----
# UNDISTORT IMAGES — OPTIONAL ALTERNATIVE
# Skip this step for the realignment workflow shown here.
# To train with corrected images instead, run Undistort.
# Connect Dense to Brush Dataset → Undistorted.
# Disconnect Brush Dataset → Sparse and skip Realignment.
# Do not supply Sparse and Undistorted together.
toggle_2 = BooleanToggle(False)
sp_undistort = SPCOLMAPUndistortImages(
    COLMAPExecutable=sp_download_tools.COLMAP,
    ActiveDataset=sp_project.ProjectRoot,
    Run=toggle_2,
    ShowTerminal=Toggle(False))  # -> ActiveDataset, ExitCode, Log, Status
panel_3 = Panel(sp_undistort.Status)

# ----
# Choose one workflow for COLMAP:
# use COLMAP All for the complete sequence, or use the individual components step by step. You do not need both. Never run both on the same project simultaneously.
# 
# All-in-one: fewer clicks, automatic stage order, combined logs and cancellation. However, it does not pause for inspection between stages; a failure stops subsequent processing.
# Step by step: easier to inspect, adjust and troubleshoot individual stages. However, it requires more manual actions and careful sequencing.
# Both use the same COLMAP processing. All-in-one saves interaction rather than inherently improving speed or quality.
# 03 COLMAP
# COLMAP Step by Step— RUN IN THIS ORDER
# SETUP — REQUIRED
# Set Prepare = True.
# Check that Valid = True before continuing.
toggle_3 = BooleanToggle(True)
sp_colmap = SPCOLMAPSetup(COLMAPExecutable=sp_download_tools.COLMAP, ProjectRoot=sp_project.ProjectRoot, Prepare=toggle_3)  # -> Valid, Database, FeatureCommand, Status
# 04 Realignment
# REALIGNMENT — OPTIONAL
# 
# Use this stage to change the reconstruction’s
# position, orientation or scale before training.
# 
# Load the exported Text model into Sparse Point Cloud
# and Camera Planes.
# 
# Adjust the geometry with Geometry Translator.
# 
# Connect its Transforms to Align COLMAP Model → Xforms.
# 
# Connect the original Text model to Align COLMAP Model → Text.
# 
# If a Data Dam is present, release the latest transforms.
# 
# Click Write and check Status.
# 
# Connect the aligned Sparse output to Brush Dataset → Sparse.
# 
# Use a positive, uniform scale factor.
# Transform the point cloud and cameras together.
# Changing the preview does not update the saved model:
# click Write again after changing the alignment.
# 
# To skip alignment, leave Brush Dataset → Sparse empty.
panel_4 = Panel(sp_colmap.Status)

# ----
# COLMAP ALL IN ONE — QUICK START
# 
# CONNECT
# Exe ← COLMAP executable
# Root ← SP Project Root
# 
# CHOOSE MATCHING
# Auto — recommended for most projects
# Sequential — one video sequence
# Exhaustive — mixed photos or multiple videos
# Spatial — photos with verified camera positions
# 
# KEEP THESE SETTINGS
# Extract, Match, Sparse, Export = True
# Undistort = False
# Extract Size = 3200
# Features = 8192
# 
# RUN
# Press Run and wait for Done.
# Enable Replace only when rebuilding an existing model.
# 
# NEXT
# Dataset → SP Brush Dataset → SP Brush Train
# 
# OPTIONAL
# Undistort=True corrects lens distortion before training.
# Terminal=True shows the live processing log.
toggle_4 = BooleanToggle(True)
list = ValueList({"Exhaustive": 0, "Exquential": 1, "Spatial": 2, "Auto": 3}, selected="Auto")
sp_colmap_all = SPCOLMAPPipeline(
    COLMAPExecutable=sp_download_tools.COLMAP,
    ProjectRoot=sp_project.ProjectRoot,
    Run=Button(),
    ReplaceExisting=Toggle(True),
    ShowTerminal=toggle_4,
    ExtractFeatures=Toggle(True),
    MatchFeatures=Toggle(True),
    ReconstructSparse=Toggle(True),
    UndistortImages=Toggle(False),
    ExportTextModel=Toggle(False),
    ShowProgress=Toggle(True),
    Cancel=Button(),
    MatchingMethod=list,
    ExtractionMaxImageSize=3200,
    MaximumFeatures=8192)  # -> ActiveDataset, ExitCode, Log, Status, Progress
panel_5 = Panel(sp_colmap_all.Status)
panel_6 = Panel(sp_colmap_all.Progress)

# ----
# SPARSE RECONSTRUCTION — REQUIRED
# Switch Run from False to True.
# Wait for successful completion.
# This calculates camera positions and a sparse 3D point cloud.
toggle_5 = BooleanToggle(True)
sp_sparse = SPCOLMAPSparseReconstruct(
    COLMAPExecutable=sp_download_tools.COLMAP,
    ProjectRoot=sp_project.ProjectRoot,
    Run=toggle_5,
    ReplaceExisting=Toggle(True),
    ShowTerminal=Toggle(True))  # -> ActiveDataset, ExitCode, Log, Status
panel_7 = Panel(sp_sparse.Status)

# ----
# EXPORT MODEL — REQUIRED
# Switch Run from False to True.
# Wait for successful completion.
# The exported Text model is used for Rhino previews,
# realignment and the Training Dataset Check.
toggle_6 = BooleanToggle(True)
sp_export = SPCOLMAPExportModel(COLMAPExecutable=sp_download_tools.COLMAP, ProjectRoot=sp_project.ProjectRoot, Run=toggle_6, ShowTerminal=Toggle(True))  # -> ActiveDataset, ExitCode, Log, Status
panel_8 = Panel(sp_export.Status)

# ----
# MATCH FEATURES — REQUIRED
# Choose a Matching method:
# • Auto: uses Spatial when all images have usable positions; otherwise Sequential for one verified video sequence; otherwise Exhaustive.
# • Exhaustive: matches all image pairs; suitable for mixed photographs, multiple videos or unordered images.
# • Sequential: matches nearby images in an ordered sequence; suitable for a single video.
# • Spatial: matches using image positions; requires distinct, usable positions for every image in the database.
# 
# Drone video telemetry is not automatically transferred to extracted frames.
# For multiple videos without complete position data, Auto uses Exhaustive.
# 
# Switch Run from False to True.
# Wait for successful completion.
# This finds corresponding features between images.
toggle_7 = BooleanToggle(True)
list_2 = ValueList({"Exhaustive": 0, "Exquential": 1, "Spatial": 2, "Auto": 3}, selected="Auto")
sp_match = SPCOLMAPMatch(
    COLMAPExecutable=sp_download_tools.COLMAP,
    ProjectRoot=sp_project.ProjectRoot,
    Run=toggle_7,
    ShowTerminal=Toggle(True),
    MatchingMethod=list_2)  # -> Database, ExitCode, Log, Status
panel_9 = Panel(sp_match.Status)

# ----
# EXTRACT FEATURES — REQUIRED
# Switch Run from False to True.
# Wait for successful completion.
# This finds recognisable features in the images.
# Extract Size controls the maximum image size used for detection.
# Features controls the maximum number of features per image.
# Changing these settings rebuilds the feature database.
toggle_8 = BooleanToggle(True)
sp_extract = SPCOLMAPFeatureExtract(
    COLMAPExecutable=sp_download_tools.COLMAP,
    ProjectRoot=sp_project.ProjectRoot,
    Run=toggle_8,
    ShowTerminal=Toggle(True),
    ExtractionMaxImageSize=3200,
    MaximumFeatures=8192)  # -> Database, ExitCode, Log, Status
panel_10 = Panel(sp_extract.Status)

# ---- group: Model preview
sp_cameras = SPCameraPlanes(
    TextModelFolder=sp_export.ActiveDataset,
    PlaneHeight=1,
    MaximumCameras=0,
    LastTextModelFolder="F:\ETH\Vorlesungen\Master\compas_3DGS\example\Demo_Opernhaus_261028\colmap\sparse-text")  # -> CameraPlanes, CameraCentres, ImageNames, Status, Frames
sp_sparse_cloud = SPSparsePointCloud(
    TextModelFolder=sp_export.ActiveDataset,
    MaximumPoints=0,
    LastTextModelFolder="F:\ETH\Vorlesungen\Master\compas_3DGS\example\Demo_Opernhaus_261028\colmap\sparse-text")  # -> PointCloud, LoadedPoints, Status

# ----
sp_quick_align = SPQuickAlign(
    SparseCloud=sp_sparse_cloud.PointCloud,
    CameraGeometry=sp_cameras.CameraPlanes,
    QuickAlignCloud="B9510B59FD9215243F6A18322AC436DF2435148DCAC161149736BA3B5ED587A6",
    QuickAlignReset=False,
    QuickAlignPair0_SX=-2.661910035,
    QuickAlignPair0_SY=1.816167555,
    QuickAlignPair0_SZ=-1.127108888,
    QuickAlignPair0_TX=86.309,
    QuickAlignPair0_TY=-25.863,
    QuickAlignPair0_TZ=0,
    QuickAlignPair1_SX=0.1045915183,
    QuickAlignPair1_SY=1.963046927,
    QuickAlignPair1_SZ=-1.179159549,
    QuickAlignPair1_TX=42.636,
    QuickAlignPair1_TY=-47.304,
    QuickAlignPair1_TZ=0,
    QuickAlignPair2_SX=-2.345570178,
    QuickAlignPair2_SY=0.3286758845,
    QuickAlignPair2_SZ=4.973585732,
    QuickAlignPair2_TX=126.278,
    QuickAlignPair2_TY=-118.312,
    QuickAlignPair2_TZ=0)  # -> AlignedCloud, AlignedCameraGeometry, Transform, SourcePoints, ReferencePoints, RMSError, Status

# ---- group: Geometry Translator / Get center point from the frames
cluster = Cluster(pt=sp_quick_align.ReferencePoints)

# ----
# Feel free to define the central point in your own way
pt = Point(cluster)

# ---- group: Geometry Translator
merge = Merge(Data1=sp_quick_align.AlignedCloud, Data2=sp_quick_align.AlignedCameraGeometry)  # -> simplify(Result)
movex = Slider(-0.95, range=-100..100)
movey = Slider(-1.56, range=-100..100)
movez = Slider(4.5, range=-100..100)
degreex = Slider(355, range=0..360)
degreey = Slider(355, range=0..360)
degreez = Slider(358, range=0..360)
scalefactor = Slider(0.96, range=0.01..50)
geo = Geometry(merge)
sp_translator = SPGeometryTranslator(
    CentrePoint=pt,
    Geometry=geo,
    MoveX=movex,
    MoveY=movey,
    MoveZ=movez,
    RotateX=degreex,
    RotateY=degreey,
    RotateZ=degreez,
    ScaleFactor=scalefactor,
    PreviousTransforms=sp_quick_align.Transform)  # -> Geometry, Transforms

# ----
dam = DataDam(DataA=sp_translator.Transforms, BufferDelay=10000000, BufferMode=0)
sp_align_model = SPAlignCOLMAPModel(COLMAPExecutable=sp_download_tools.COLMAP, ActiveDataset=sp_project.ProjectRoot, Transforms=dam, Write=Button())  # -> AlignedTextModel, flatten(AlignedSparseModel), Log, Status

# ---- group: result preview
sp_sparse_cloud_2 = SPSparsePointCloud(
    TextModelFolder=sp_align_model.AlignedTextModel,
    MaximumPoints=100000,
    LastTextModelFolder="F:\ETH\Vorlesungen\Master\compas_3DGS\example\Demo_Opernhaus_261028\colmap\aligned\sparse-text")  # -> PointCloud, LoadedPoints, Status
sp_cameras_2 = SPCameraPlanes(
    TextModelFolder=sp_align_model.AlignedTextModel,
    PlaneHeight=1,
    MaximumCameras=0,
    LastTextModelFolder="F:\ETH\Vorlesungen\Master\compas_3DGS\example\Demo_Opernhaus_261028\colmap\aligned\sparse-text")  # -> CameraPlanes, CameraCentres, ImageNames, Status, Frames

# ----
# 05 Training
# DATASET CHECK — OPTIONAL, RECOMMENDED
# After sparse reconstruction and text export, click Update.
# Check Valid and read Status.
# This check examines the original project reconstruction.
# It does not validate an aligned or undistorted alternative.
# 
# CHOOSE ONE DATASET SOURCE — REQUIRED
# 
# 1.Original reconstruction:
# Leave Sparse and Undistorted empty.
# 
# 2.Aligned reconstruction:
# Connect Align COLMAP Model → Sparse.
# Leave Undistorted empty.
# 
# 3.Undistorted reconstruction:
# Connect Undistort Images → Dense to Undistorted.
# Leave Sparse empty.
# 
# Do not connect Sparse and Undistorted together.
# The current dataset preparation component does not
# combine realignment with the undistorted workflow.
# 
# PREPARE DATASET — REQUIRED
# Connect Project Root and choose the dataset source.
# Set Prepare = True.
# Check that Status confirms successful preparation.
# Connect Dataset to Brush Train → Dataset.
# Prepare again after changing the source model.
# 
# TRAIN — REQUIRED
# Connect the Brush executable, Dataset and Project Root.
# Set a job Name and the number of Steps.
# Activate Run once and wait for successful completion.
# Export gives the folder containing the saved PLY files.
button = Button()
sp_dataset = SPActiveDataset(ProjectRoot=sp_project.ProjectRoot, Update=button)  # -> ActiveDataset, Valid, SourceImages, RegisteredImages, SparsePoints, Status
sp_brush_data = SPBrushDataset(ActiveDataset=sp_project.ProjectRoot, Prepare=Toggle(True), SparseModelOverride=sp_align_model.AlignedSparseModel)  # -> BrushDataset, Status
sp_brush_train = SPBrushTrain(
    BrushExecutable=sp_download_tools.Brush,
    BrushDataset=sp_brush_data.BrushDataset,
    ProjectRoot=sp_project.ProjectRoot,
    JobName="brush",
    TotalSteps=Slider(10000, range=5000..30000),
    OpenBrushViewer=Toggle(True),
    Run=Button(),
    ReplaceExisting=Toggle(True),
    ShowTerminal=Toggle(True),
    RotateForVisualization=Toggle(True),
    Cancel=Button(),
    MaximumTrainingResolution=1920,
    MaximumSplatCount=10000000)  # -> ExportFolder, ExitCode, Log, Status
panel_11 = Panel(sp_dataset.Status)
panel_12 = Panel(sp_brush_data.BrushDataset)
panel_13 = Panel(sp_brush_train.Status)

path_2 = FilePath("F:\ETH\Vorlesungen\Master\compas_3DGS\example\Demo_Opernhaus_261028\output\brush\sp_10000_rgs.ply")

# ----
# PREVIEW — OPTIONAL
# 
# Select an exported Brush PLY and connect it to Splat Preview.
# Enable component preview to view the result in Rhino.
# Reduce Max for faster viewport navigation.
# This component displays a coloured point-cloud preview
# and preserves the PLY’s coordinates.
# 
# For full Gaussian splatting visualization in Rhino on Windows,
# install RhinoGaussianSplatting or Krill and import the exported PLY.
# These plugins render the Gaussian splats with their transparency
# and appearance. They are separate installations from Splatypus.
# 
# For Splat Preview, use the original Brush PLY.
# For RhinoGaussianSplatting and Krill, enable Rotate for Visualization
# during training and use the additional _rgs.ply.
panel_14 = Panel("2000000")
path_3 = FilePath()
sp_splat_preview = SPSplatPreview(BrushPLY=path_3, MaximumSplats=panel_14)  # -> PreviewCloud, LoadedSplats, Status
panel_15 = Panel(sp_splat_preview.Status)

# ----
# 02 Dataset
# FFMPEG CHECK — OPTIONAL
# Use FFmpeg Setup to validate the executable.
# Valid = True confirms that FFmpeg can be used.
# 
# MEDIA IMPORT — REQUIRED UNLESS IMAGES ARE ALREADY PREPARED
# Connect FFmpeg, Project Root and your media sources.
# Sources may be videos, image files or folders.
# For videos, set FPS to control the number of extracted frames.
# Still images produce one JPEG per image.
# Check Estimate, then click Run.
# Recommended number of images: 300 to 600
# 
# Wait until the import completes successfully.
path_4 = FilePath(["F:\ETH\Vorlesungen\Master\compas_3DGS\example\images\DJI_0994.JPG", "F:\ETH\Vorlesungen\Master\compas_3DGS\example\images\DJI_0995.JPG", "F:\ETH\Vorlesungen\Master\compas_3DGS\example\images\DJI_0996.JPG", "F:\ETH\Vorlesungen\Master\compas_3DGS\example\images\DJI_0997.JPG", "F:\ETH\Vorlesungen\Master\compas_3DGS\example\images\DJI_0998.JPG"])
path_5 = FilePath(["F:\DJI_Lab\103MEDIA\DJI_0001.MP4", "F:\DJI_Lab\103MEDIA\DJI_0002.MP4", "F:\DJI_Lab\103MEDIA\DJI_0003.MP4", "F:\DJI_Lab\103MEDIA\DJI_0004.MP4", "F:\DJI_Lab\103MEDIA\DJI_0005.MP4", "F:\DJI_Lab\103MEDIA\DJI_0006.MP4", "F:\DJI_Lab\103MEDIA\DJI_0007.MP4", "F:\DJI_Lab\103MEDIA\DJI_0008.MP4", "F:\DJI_Lab\103MEDIA\DJI_0010.MP4", "F:\DJI_Lab\103MEDIA\DJI_0011.MP4", "F:\DJI_Lab\103MEDIA\DJI_0012.MP4", "F:\DJI_Lab\103MEDIA\DJI_0013.MP4", "F:\DJI_Lab\103MEDIA\DJI_0014.MP4", "F:\DJI_Lab\103MEDIA\DJI_0999.MP4"])
list_3 = ValueList({"jpeg": 0, "png": 1}, selected="png")
# CONTROLS
# Button: click once.
# Toggle: double-click to switch between False and True.
# Run starts when its input changes from False to True.
# Before running again, reset Run to False.
# Wait for successful completion before starting the next operation.
# Read Status for progress, results and errors.
sp_ffmpeg = SPFFmpegSetup(FFmpegExecutable=sp_download_tools.FFmpeg)  # -> Valid, FFmpeg, DecoderCommand, Status

# ---- group: video, images or media folder
add = Merge(Data1=path_4, Data2=path_5)

# ----
sp_media_import = SPMediaImport(
    FFmpegExecutable=sp_download_tools.FFmpeg,
    ProjectRoot=sp_project.ProjectRoot,
    MediaSources=add,
    VideoFramesPerSecond=Slider(2, range=0.1..30),
    Run=Button(),
    ReplacePreviousImport=Toggle(True),
    ShowTerminal=Toggle(True),
    Cancel=Button(),
    ImageFormat=list_3,
    SkipNearDuplicates=Toggle(True))  # -> ImagesFolder, ImportedImages, ImageCount, Log, Status, EstimatedImages, ProbeStatus
panel_16 = Panel(sp_media_import.ImageCount)
panel_17 = Panel(sp_media_import.EstimatedImages)
panel_18 = Panel(sp_media_import.ImagesFolder)
panel_19 = Panel(sp_media_import.Status)
panel_20 = Panel(sp_media_import.ProbeStatus)

# ----
# 06 Preview
# VIDEO FRAMES & CAMERA PLAYBACK OPTIONAL
# 
# SP Media Import extracts images from the source videos.
# SP Video Frames groups those images by video and pairs them with the reconstructed camera poses.
# 
# Connect Tracks to SP Video Playback and select a Video Index (starting at 0).
# Play animates the active Rhino viewport along the camera track.
# 
# Speed controls playback rate, Loop repeats the sequence, and Smooth softens camera movement.
# Restore returns to the original view.
sp_video_frames = SPVideoFrames(ActiveDataset=sp_dataset.ActiveDataset, Media=add)  # -> Frames, Videos, Times, Registered, Tracks, Status
sp_video_playback = SPVideoPlayback(
    Tracks=sp_video_frames.Tracks,
    VideoIndex=Slider(5, range=1..10),
    Play=Toggle(True),
    Time=0,
    Speed=Slider(6, range=1..10),
    Loop=Toggle(False),
    Preview=Toggle(False),
    Smooth=Toggle(True),
    RestoreView=Button())  # -> Camera, Time, Duration, Frame, Status
panel_21 = Panel(sp_video_playback.Status)

# ----
# CAPTURE THE RHINO SCENE WITH AUTOMATIC BACKGROUND - OPTIONAL
# 
# Connect Frames from SP Camera Planes to both SP Auto Background and SP View Capture.
# Keep the camera frames, splat and Rhino geometry aligned.
# 
# Connect the displayed splat PLY to SP Auto Background. If the splat was transformed in Rhino, supply the same transform to XForm.
# Match Lens on both components and set Aspect to Width ÷ Height (1920 ÷ 1280 = 1.5).
# 
# SP Auto Background estimates a stable backdrop from the splat’s boundary colors across the camera sequence.
# Connect Bottom → View Capture BG and Top → View Capture Top for a gradient. For a solid background, connect BG → View Capture BG and leave Top empty.
# Enable Preview to inspect the backdrop. Wire the colors explicitly: preview alone does not set the capture background.
# Connect a fresh SP Project Root to View Capture Root. Set Width, Height, Mode and Lens.
# Pause playback, hide camera guides and unwanted previews, then press Run. Keep the viewport visible and increase Wait if the splat renderer needs more time to update.
# 
# Each frame produces a PNG. Dataset contains the captured images and matching camera calibration, ready for SP Brush Dataset → SP Brush Train.
# Lens and image proportions define the new framing.
# The automatic background changes only the backdrop; keep the splat renderer’s relighting off. Inspect a small capture batch before running the full sequence.
enter_a_project_name_2 = Panel("")
sp_project_2 = SPProject(ParentFolder=path, ProjectName=enter_a_project_name_2, Create=Toggle(True))  # -> ProjectRoot, Images, COLMAP, Brush, Status
number_slider = Slider(35, range=24..50)
panel_22 = Panel(sp_project_2.Status)
list_4 = ValueList({"Rendered", "Shaded", "Ghosted": , "Ghosted", "Wireframe": , "Wireframe", "Arctic": , "Arctic"}, selected="Shaded")
cancel = Button()
run = Button()

sp_auto_background = SPAutoBackground(SplatPLY=path_2, Frames=sp_cameras_2.Frames, Lens=number_slider, Aspect=1.5, MaximumSamples=50000, Preview=Toggle(True))  # -> Background, Top, Bottom, Status

sp_view_capture = SPViewCapture(
    Frames=sp_cameras_2.Frames,
    Width="1920",
    Height="1280",
    DisplayMode=list_4,
    Lens=number_slider,
    Background=sp_auto_background.Bottom,
    Root=sp_project_2.ProjectRoot,
    Run=run,
    Cancel=cancel,
    Wait=1,
    BackgroundTop=sp_auto_background.Top)  # -> Images, ActiveDataset, Progress, Status
panel_23 = Panel(sp_view_capture.Progress)
panel_24 = Panel(sp_view_capture.Status)

# ----
# TRAIN A NEW GAUSSIAN SPLAT - OPTIONAL
# 
# Connect Dataset from SP View Capture to SP Brush Dataset and enable Prepare.
# Connect its Dataset output to SP Brush Train.
# Set the Brush executable, output Root, a new job Name and training Steps, then press Run.
# 
# Training uses the new Rhino images with the camera poses inherited from the previous reconstruction.
# No new camera reconstruction is needed.
# 
# Current limitation: View Capture writes a new camera-only COLMAP model with calibration matching the captured images.
# It does not copy the previous sparse point cloud. Leave Sparse empty for this workflow; Brush initializes without those points.
# Reusing the original sparse points requires an additional preparation step that preserves the new image names and calibration.
toggle_9 = BooleanToggle(True)
sp_brush_data_2 = SPBrushDataset(ActiveDataset=sp_view_capture.ActiveDataset, Prepare=toggle_9, SparseModelOverride=sp_align_model.AlignedSparseModel)  # -> BrushDataset, Status
sp_brush_train_2 = SPBrushTrain(
    BrushExecutable=sp_download_tools.Brush,
    BrushDataset=sp_brush_data_2.BrushDataset,
    ProjectRoot=sp_project_2.ProjectRoot,
    JobName="brush",
    TotalSteps=Slider(30000, range=5000..30000),
    OpenBrushViewer=Toggle(True),
    Run=Button(),
    ReplaceExisting=Toggle(True),
    ShowTerminal=Toggle(True),
    RotateForVisualization=Toggle(True),
    Cancel=Button(),
    MaximumTrainingResolution=1920,
    MaximumSplatCount=10000000)  # -> ExportFolder, ExitCode, Log, Status
panel_25 = Panel(sp_brush_train_2.Status)

# ==== cluster Cluster
pt = ClusterInput()
pt_2 = Point(pt)
ma = MassAddition(Input=pt_2)  # -> Result, PartialResults
lng = ListLength(List=pt_2)
division = Division(A=ma.Result, B=lng)
R = ClusterOutput(division)
